# Dynamo graph debug.dyn (Dynamo 2.4.1.6394)

code_block = CodeBlock { "Huber"; "Stefan"; "TUMCMS"; }
IFC_root = IfcInfraToolkit_Dyn.IFC_root.IFC_root(FamilyName=code_block.out0, first_name=code_block.out1, organzization=code_block.out2)
file_path = Filename(".\sample_export.ifc")
IFC_export = IfcInfraToolkit_Dyn.IFC_root.IFC_export(iFC_root=IFC_root, filepath=file_path)
