# Dynamo graph CreateSpatialStructure.dyn (Dynamo 2.8.0.2471)

createIfcModel = IfcInfraToolKit_DynamoCore.IfcModelSetup.CreateIfcModel()
code_block = CodeBlock { "testFacility"; }
code_block_2 = CodeBlock { "null"; }
addFacility = IfcInfraToolKit_DynamoCore.IfcModelSetup.AddFacility(databaseContainer=createIfcModel, facilityName=code_block, hostGuid=code_block_2)
code_block_3 = CodeBlock { "testPart"; }
watch = Watch(addFacility.FacilityGUID)
addFacilityPart = IfcInfraToolKit_DynamoCore.IfcModelSetup.AddFacilityPart(databaseContainer=addFacility.DatabaseContainer, facilityPartName=code_block_3, hostGUID=watch)
directory_path = Directory("C:\Users\Sebastian Esser\Desktop")
code_block_4 = CodeBlock { "blub"; }
saveIfcModel = IfcInfraToolKit_DynamoCore.IfcModelSetup.SaveIfcModel(container=addFacilityPart.DatabaseContainer, path=directory_path, modelName=code_block_4)
watch_2 = Watch(addFacilityPart.FacilityPartGUID)
