# Dynamo graph cuboidBridge.dyn (Dynamo 2.3.0.5885)

code_block = CodeBlock { 6; 0.8; 4; }
byLengths = Cuboid.ByLengths(width=code_block.out0, length=code_block.out1, height=code_block.out2)
code_block_2 = CodeBlock { 10; }
translate = Geometry.Translate(geometry=byLengths, yTranslation=code_block_2)
code_block_3 = CodeBlock { 6; 0.8; 4; }
byLengths_2 = Cuboid.ByLengths(width=code_block_3.out0, length=code_block_3.out1, height=code_block_3.out2)
createIfcModel = IfcInfraToolKit_DynamoCore.IfcModelSetup.CreateIfcModel()
code_block_4 = CodeBlock { "null"; }
exportSolidGeometryAsBRep = IfcInfraToolKit_DynamoCore.DynamoGeometryExporter.ExportSolidGeometryAsBRep(solidGeometry=byLengths_2, databaseContainer=createIfcModel, productGuid=code_block_4)
exportSolidGeometryAsBRep_2 = IfcInfraToolKit_DynamoCore.DynamoGeometryExporter.ExportSolidGeometryAsBRep(solidGeometry=translate, databaseContainer=exportSolidGeometryAsBRep.DatabaseContainer, productGuid=code_block_4)
directory_path = Directory("C:\Users\janin\OneDrive\Dokumente\HiwiCMS\IfcInfraToolkit")
code_block_5 = CodeBlock { "cuboidBridge"; }
saveIfcModel = IfcInfraToolKit_DynamoCore.IfcModelSetup.SaveIfcModel(container=exportSolidGeometryAsBRep_2.DatabaseContainer, path=directory_path, modelName=code_block_5)
code_block_6 = CodeBlock { 0.2; 12; 7; }
byLengths_3 = Cuboid.ByLengths(width=code_block_6.out2, length=code_block_6.out1, height=code_block_6.out0)
code_block_7 = CodeBlock { 5; }
code_block_8 = CodeBlock { 2.1; }
translate_2 = Geometry.Translate(geometry=byLengths_3, yTranslation=code_block_7, zTranslation=code_block_8)
watch = Watch(exportSolidGeometryAsBRep.centerOfGravity)
watch_2 = Watch(exportSolidGeometryAsBRep_2.centerOfGravity)
