# Dynamo graph simpleGeometryExport.dyn (Dynamo 2.8.0.2471)

# group: User Input
code_block = CodeBlock { 10; 50; 200; }
code_block_2 = CodeBlock { "null"; }
directory_path = Directory("C:\Users\Sebastian Esser\Desktop")
code_block_3 = CodeBlock { "cuboid"; }

# group: Geometry Modeling
byLengths = Cuboid.ByLengths(width=code_block.out0, length=code_block.out1, height=code_block.out2)

# group: IFC model setup
createIfcModel = IfcInfraToolKit_DynamoCore.IfcModelSetup.CreateIfcModel()
getGeometryInformation = IfcInfraToolKit_DynamoCore.DynamoGeometryExporter.GetGeometryInformation(solidGeometry=byLengths, databaseContainer=createIfcModel, productGuid=code_block_2)
saveIfcModel = IfcInfraToolKit_DynamoCore.IfcModelSetup.SaveIfcModel(container=getGeometryInformation.DatabaseContainer, path=directory_path, modelName=code_block_3)
