# Dynamo graph PTworkflow.dyn (Dynamo 2.8.0.2471)

file_path = Filename(".\pier_1.off")
loadOffGeometry = IfcInfraToolKit_DynamoCore.MeshImporter.LoadOffGeometry(offFilePath=file_path)
toDynamoPoints = IfcInfraToolKit_DynamoCore.MeshImporter.ToDynamoPoints(geometry=loadOffGeometry)
byPoints = Tessellation.Delaunay.ByPoints(points=toDynamoPoints)
flatten = List.Flatten(list=loadOffGeometry)
