# Dynamo graph PTworkflow_GetGeomData.dyn (Dynamo 2.8.0.2471)

# group: MeshImport
file_path = Filename("geometryFiles\LoD200\pathway.off")
loadOffGeometry = IfcInfraToolKit_DynamoCore.MeshImporter.LoadOffGeometry(offFilePath=file_path)
list_create = List.Create(item0=loadOffGeometry)
toDynamoPatches = IfcInfraToolKit_DynamoCore.MeshImporter.ToDynamoPatches(geometry=list_create)

byJoinedSurfaces = Solid.ByJoinedSurfaces(facesOfSolid=toDynamoPatches)
code_block = CodeBlock { "null"; }
directory_path = Directory("C:\Users\Sebastian Esser\Desktop")
code_block_2 = CodeBlock { "DeckOnly"; }

# group: IFC setup
createIfcModel = IfcInfraToolKit_DynamoCore.IfcModelSetup.CreateIfcModel()
getGeometryInformation = IfcInfraToolKit_DynamoCore.DynamoGeometryExporter.GetGeometryInformation(solidGeometry=byJoinedSurfaces, databaseContainer=createIfcModel, productGuid=code_block)
saveIfcModel = IfcInfraToolKit_DynamoCore.IfcModelSetup.SaveIfcModel(container=getGeometryInformation.DatabaseContainer, path=directory_path, modelName=code_block_2)
